# Dynamo graph Ceiling Opening V 1.4.dyn (Dynamo 2.12.1.8246)
# packages: spring nodes 210.1.1, Universo_BIM 17.3.21, bimorphNodes 4.2.4, Genius Loci 2023.1.23, Rhythm 2023.9.1

# group: Familt Data
type = Elements.Element.Type()  # unwired: element
parameters = Element.Parameters(element=type)
watch = Watch(parameters)
parameters_2 = Element.Parameters()  # unwired: element
watch_2 = Watch(parameters_2)

# group: Get J5.1 Ceiling
categories = Categories("OST_Ceilings")
all_elements_of_category = ElementsOfCategory(Category=categories)
name = Element.Name(element=all_elements_of_category)
code_block = CodeBlock { "J5.1"; }
eq = name == code_block
filterByBoolMask = List.FilterByBoolMask(list=all_elements_of_category, mask=eq)

# group: Get the light sourse
categories_2 = Categories("OST_RvtLinks")
all_elements_of_category_2 = ElementsOfCategory(Category=categories_2)
categories_3 = Categories("OST_DuctTerminal")
ofCategory = Revit.LinkElement.OfCategory(linkInstance=all_elements_of_category_2, category=categories_3)
flatten = List.Flatten(list=ofCategory)
name_2 = Element.Name(element=flatten)
code_block_2 = CodeBlock { "1 slot"; }
eq_2 = name_2 == code_block_2
code_block_3 = CodeBlock { "25mm SLOT"; }
eq_3 = name_2 == code_block_3
or_ = eq_2 || eq_3
code_block_4 = CodeBlock { "50mm SLOT"; }
eq_4 = name_2 == code_block_4
or_2 = or_ || eq_4
filterByBoolMask_2 = List.FilterByBoolMask(list=flatten, mask=or_2)
code_block_5 = CodeBlock { "1S-25Wx1000L"; }
eq_5 = name_2 == code_block_5
filterByBoolMask_3 = List.FilterByBoolMask(list=flatten, mask=eq_5)
code_block_6 = CodeBlock { "Grille On/Off"; }
ʳʰʸᵗʰᵐ_elements = Rhythm.Revit.Elements.Elements.GetParameterValueByNameTypeOrInstance(element=filterByBoolMask_3.in, parameterName=code_block_6)
code_block_7 = CodeBlock { 1; }
eq_6 = ʳʰʸᵗʰᵐ_elements == code_block_7
filterByBoolMask_4 = List.FilterByBoolMask(list=filterByBoolMask_3.in, mask=eq_6)
join = List.Join(list0=filterByBoolMask_2.in, list1=filterByBoolMask_4.in)

# group: Remove Cylinder
geometry = Element.Geometry(element=filterByBoolMask_2.in)
geometry_2 = Element.Geometry(element=filterByBoolMask_4.in)
string_from_object = FromObject(object=geometry_2)
code_block_8 = CodeBlock { "Solid"; }
eq_7 = string_from_object == code_block_8
filterByBoolMask_5 = List.FilterByBoolMask(list=geometry_2, mask=eq_7)
code_block_9 = CodeBlock { 2; }
removeItemAtIndex = List.RemoveItemAtIndex(list=filterByBoolMask_5.in@L2, indices=code_block_9)
join_2 = List.Join(list0=geometry, list1=removeItemAtIndex)

# group: Get Geometry
list_clean = Custom[List Clean](list=join_2)  # package Genius Loci; Removes all Null, Empty and Blank from a list or nested list of lists.
byGeometry = BoundingBox.ByGeometry(geom=list_clean)
toCuboid = BoundingBox.ToCuboid(boundingBox=byGeometry)

# group: Get Geometry
geometry_3 = Element.Geometry(element=filterByBoolMask.in)
flatten_2 = List.Flatten(list=geometry_3)
doesIntersect = Geometry.DoesIntersect(geometry=flatten_2@L1, other=toCuboid)
anyTrue = List.AnyTrue(list=doesIntersect, lacing=Longest)
filterByBoolMask_6 = List.FilterByBoolMask(list=flatten_2, mask=anyTrue)
flatten_3 = List.Flatten(list=filterByBoolMask_6.in)

# group (continued): Get J5.1 Ceiling
filterByBoolMask_7 = List.FilterByBoolMask(list=filterByBoolMask.in, mask=anyTrue)

# group: Get Points
code_block_10 = CodeBlock { 1; }
chop = List.Chop(list=filterByBoolMask_7.in, lengths=code_block_10)
intersectAll = Geometry.IntersectAll(geometry=flatten_3@L1, others=toCuboid, lacing=CrossProduct)
flatten_4 = List.Flatten(list=intersectAll@L3)
list_clean_2 = Custom[List Clean](list=flatten_4)
centroid = Solid.Centroid(solid=list_clean_2)

# group: Family Creator
code_block_11 = CodeBlock { "Ar_GM_Void_Slab_Opening_Rectangle"; }
byName = Family.ByName(name=code_block_11)
types = Family.Types(family=byName)
ꟿ_familyinstance_byhostandpoint = Custom[ꟿ FamilyInstance.ByHostAndPoint](host=chop, type=types, point=centroid)  # package spring nodes; Creates hosted family instances(doors/windows) at the specified points. You can feed either a single family type or a unique type for each instance.
flatten_5 = List.Flatten(list=ꟿ_familyinstance_byhostandpoint)

# group: Get Data
flatten_6 = List.Flatten(list=join)
doesIntersect_2 = Geometry.DoesIntersect(geometry=flatten_2, other=toCuboid@L1)
anyTrue_2 = List.AnyTrue(list=doesIntersect_2@L2)
filterByBoolMask_8 = List.FilterByBoolMask(list=flatten_6, mask=anyTrue_2)
flatten_7 = List.Flatten(list=filterByBoolMask_8.in)

# group: Get Data
flatten_8 = List.Flatten(list=flatten_7)
geometry_4 = Element.Geometry(element=flatten_8)
byGeometry_2 = BoundingBox.ByGeometry(geom=geometry_4)
toCuboid_2 = BoundingBox.ToCuboid(boundingBox=byGeometry_2)
code_block_12 = CodeBlock { 1; }
chop_2 = List.Chop(list=toCuboid_2, lengths=code_block_12)
byGeometry_3 = BoundingBox.ByGeometry(geom=chop_2)
flatten_9 = List.Flatten(list=byGeometry_3)
flatten_10 = List.Flatten(list=centroid)
contains = BoundingBox.Contains(boundingBox=flatten_9, point=flatten_10, lacing=CrossProduct)
code_block_13 = CodeBlock { true; }
indexOf = List.IndexOf(list=contains@L2, element=code_block_13)
sortByKey = List.SortByKey(list=flatten_8, keys=indexOf)
flatten_11 = List.Flatten(list=sortByKey.sortedList)

# group: Change groub
name_3 = Element.Name(element=flatten_11)
code_block_14 = CodeBlock { "1S-25Wx1000L"; }
eq_8 = name_3 == code_block_14
filterByBoolMask_9 = List.FilterByBoolMask(list=flatten_5, mask=eq_8)
filterByBoolMask_10 = List.FilterByBoolMask(list=flatten_11, mask=eq_8)

# group: Rotation
geometry_5 = Element.Geometry(element=filterByBoolMask_10.out)
byGeometry_4 = BoundingBox.ByGeometry(geom=geometry_5)
toCuboid_3 = BoundingBox.ToCuboid(boundingBox=byGeometry_4)
length = Cuboid.Length(cuboid=toCuboid_3)
width = Cuboid.Width(cuboid=toCuboid_3)
lt = length < width

# group: Angle
filterByBoolMask_11 = List.FilterByBoolMask(list=filterByBoolMask_9.out, mask=lt)
filterByBoolMask_12 = List.FilterByBoolMask(list=filterByBoolMask_10.out, mask=lt)

# group: Get Dimension
code_block_15 = CodeBlock { "Width"; }
code_block_16 = CodeBlock { "Slot Width"; }
ʳʰʸᵗʰᵐ_elements_2 = Rhythm.Revit.Elements.Elements.GetParameterValueByNameTypeOrInstance(element=filterByBoolMask_12.out, parameterName=code_block_16)
code_block_17 = CodeBlock { "Length"; }
ʳʰʸᵗʰᵐ_elements_3 = Rhythm.Revit.Elements.Elements.GetParameterValueByNameTypeOrInstance(element=filterByBoolMask_12.out, parameterName=code_block_17)
code_block_18 = CodeBlock(width=ʳʰʸᵗʰᵐ_elements_2, lengeh=ʳʰʸᵗʰᵐ_elements_3) { width+20; lengeh-50; }
ʳʰʸᵗʰᵐ_elements_4 = Rhythm.Revit.Elements.Elements.SetParameterByNameTypeOrInstance(element=filterByBoolMask_11.out, parameterName=code_block_15, value=code_block_18.out0, lacing=Longest)
code_block_19 = CodeBlock { "Length"; }
ʳʰʸᵗʰᵐ_elements_5 = Rhythm.Revit.Elements.Elements.SetParameterByNameTypeOrInstance(element=filterByBoolMask_11.out, parameterName=code_block_19, value=code_block_18.out1, lacing=Longest)

# group: Get Dimension
code_block_20 = CodeBlock { "Length"; }
code_block_21 = CodeBlock { "Slot Width"; }
ʳʰʸᵗʰᵐ_elements_6 = Rhythm.Revit.Elements.Elements.GetParameterValueByNameTypeOrInstance(element=filterByBoolMask_12.in, parameterName=code_block_21)
code_block_22 = CodeBlock { "Length"; }
ʳʰʸᵗʰᵐ_elements_7 = Rhythm.Revit.Elements.Elements.GetParameterValueByNameTypeOrInstance(element=filterByBoolMask_12.in, parameterName=code_block_22)
code_block_23 = CodeBlock(width=ʳʰʸᵗʰᵐ_elements_6, lengeh=ʳʰʸᵗʰᵐ_elements_7) { width+20; lengeh-50; }
ʳʰʸᵗʰᵐ_elements_8 = Rhythm.Revit.Elements.Elements.SetParameterByNameTypeOrInstance(element=filterByBoolMask_11.in, parameterName=code_block_20, value=code_block_23.out0, lacing=Longest)
code_block_24 = CodeBlock { "Width"; }
ʳʰʸᵗʰᵐ_elements_9 = Rhythm.Revit.Elements.Elements.SetParameterByNameTypeOrInstance(element=filterByBoolMask_11.in, parameterName=code_block_24, value=code_block_23.out1, lacing=Longest)

# group: Rotation
geometry_6 = Element.Geometry(element=filterByBoolMask_10.in)
byGeometry_5 = BoundingBox.ByGeometry(geom=geometry_6)
toCuboid_4 = BoundingBox.ToCuboid(boundingBox=byGeometry_5)
length_2 = Cuboid.Length(cuboid=toCuboid_4)
width_2 = Cuboid.Width(cuboid=toCuboid_4)
lt_2 = length_2 < width_2

# group: Angle
filterByBoolMask_13 = List.FilterByBoolMask(list=filterByBoolMask_9.in, mask=lt_2)
filterByBoolMask_14 = List.FilterByBoolMask(list=filterByBoolMask_10.in, mask=lt_2)

# group: Get Dimension
code_block_25 = CodeBlock { "Length"; }
code_block_26 = CodeBlock { "Slot Width"; }
ʳʰʸᵗʰᵐ_elements_10 = Rhythm.Revit.Elements.Elements.GetParameterValueByNameTypeOrInstance(element=filterByBoolMask_14.in, parameterName=code_block_26)
code_block_27 = CodeBlock { "BKG_Planum L"; }
ʳʰʸᵗʰᵐ_elements_11 = Rhythm.Revit.Elements.Elements.GetParameterValueByNameTypeOrInstance(element=filterByBoolMask_14.in, parameterName=code_block_27)
code_block_28 = CodeBlock(width=ʳʰʸᵗʰᵐ_elements_10, lengeh=ʳʰʸᵗʰᵐ_elements_11) { width+20; lengeh; }
ʳʰʸᵗʰᵐ_elements_12 = Rhythm.Revit.Elements.Elements.SetParameterByNameTypeOrInstance(element=filterByBoolMask_13.in, parameterName=code_block_25, value=code_block_28.out0, lacing=Longest)
code_block_29 = CodeBlock { "Width"; }
ʳʰʸᵗʰᵐ_elements_13 = Rhythm.Revit.Elements.Elements.SetParameterByNameTypeOrInstance(element=filterByBoolMask_13.in, parameterName=code_block_29, value=code_block_28.lengeh, lacing=Longest)

# group: Get Dimension
code_block_30 = CodeBlock { "Length"; }
code_block_31 = CodeBlock { "Slot Width"; }
ʳʰʸᵗʰᵐ_elements_14 = Rhythm.Revit.Elements.Elements.GetParameterValueByNameTypeOrInstance(element=filterByBoolMask_14.out, parameterName=code_block_31)
code_block_32 = CodeBlock { "BKG_Planum L "; }
ʳʰʸᵗʰᵐ_elements_15 = Rhythm.Revit.Elements.Elements.GetParameterValueByNameTypeOrInstance(element=filterByBoolMask_14.out, parameterName=code_block_32)
code_block_33 = CodeBlock(width=ʳʰʸᵗʰᵐ_elements_14, lengeh=ʳʰʸᵗʰᵐ_elements_15) { width+20; lengeh; }
ʳʰʸᵗʰᵐ_elements_16 = Rhythm.Revit.Elements.Elements.SetParameterByNameTypeOrInstance(element=filterByBoolMask_13.out, parameterName=code_block_30, value=code_block_33.lengeh, lacing=Longest)
code_block_34 = CodeBlock { "Width"; }
ʳʰʸᵗʰᵐ_elements_17 = Rhythm.Revit.Elements.Elements.SetParameterByNameTypeOrInstance(element=filterByBoolMask_13.out, parameterName=code_block_34, value=code_block_33.out0, lacing=Longest)

# group: Get J5.1 Ceiling
categories_4 = Categories("OST_Ceilings")
all_elements_of_category_3 = ElementsOfCategory(Category=categories_4)
name_4 = Element.Name(element=all_elements_of_category_3)
code_block_35 = CodeBlock { "J5.1"; }
eq_9 = name_4 == code_block_35
filterByBoolMask_15 = List.FilterByBoolMask(list=all_elements_of_category_3, mask=eq_9)

# group: Get the light sourse
categories_5 = Categories("OST_RvtLinks")
all_elements_of_category_4 = ElementsOfCategory(Category=categories_5)
categories_6 = Categories("OST_Sprinklers")
ofCategory_2 = Revit.LinkElement.OfCategory(linkInstance=all_elements_of_category_4, category=categories_6)
flatten_12 = List.Flatten(list=ofCategory_2)
name_5 = Element.Name(element=flatten_12)
code_block_36 = CodeBlock { "SP-6"; }
eq_10 = name_5 == code_block_36
filterByBoolMask_16 = List.FilterByBoolMask(list=flatten_12, mask=eq_10)

# group: Get Geometry
geometry_7 = Element.Geometry(element=filterByBoolMask_16.in)
list_clean_3 = Custom[List Clean](list=geometry_7)
byGeometry_6 = BoundingBox.ByGeometry(geom=list_clean_3)
toCuboid_5 = BoundingBox.ToCuboid(boundingBox=byGeometry_6)

# group: Get Geometry
geometry_8 = Element.Geometry(element=filterByBoolMask_15.in)
flatten_13 = List.Flatten(list=geometry_8)
doesIntersect_3 = Geometry.DoesIntersect(geometry=flatten_13@L1, other=toCuboid_5)
anyTrue_3 = List.AnyTrue(list=doesIntersect_3, lacing=Longest)
filterByBoolMask_17 = List.FilterByBoolMask(list=flatten_13, mask=anyTrue_3)
flatten_14 = List.Flatten(list=filterByBoolMask_17.in)

# group (continued): Get J5.1 Ceiling
filterByBoolMask_18 = List.FilterByBoolMask(list=filterByBoolMask_15.in, mask=anyTrue_3)

# group: Get Points
code_block_37 = CodeBlock { 1; }
chop_3 = List.Chop(list=filterByBoolMask_18.in, lengths=code_block_37)
intersectAll_2 = Geometry.IntersectAll(geometry=flatten_14@L1, others=toCuboid_5, lacing=CrossProduct)
flatten_15 = List.Flatten(list=intersectAll_2@L3)
list_clean_4 = Custom[List Clean](list=flatten_15)
centroid_2 = Solid.Centroid(solid=list_clean_4)

# group: Family Creator
code_block_38 = CodeBlock { "Ar_GM_Void_Slab_Opening_Circular"; }
byName_2 = Family.ByName(name=code_block_38)
types_2 = Family.Types(family=byName_2)
ꟿ_familyinstance_byhostandpoint_2 = Custom[ꟿ FamilyInstance.ByHostAndPoint](host=chop_3, type=types_2, point=centroid_2)
code_block_39 = CodeBlock { "Radius"; }
code_block_40 = CodeBlock { 27.4; }
ʳʰʸᵗʰᵐ_elements_18 = Rhythm.Revit.Elements.Elements.SetParameterByNameTypeOrInstance(element=ꟿ_familyinstance_byhostandpoint_2, parameterName=code_block_39, value=code_block_40, lacing=Longest)

# group: Get J5.1 Ceiling
categories_7 = Categories("OST_Ceilings")
all_elements_of_category_5 = ElementsOfCategory(Category=categories_7)
name_6 = Element.Name(element=all_elements_of_category_5)
code_block_41 = CodeBlock { "J5.1"; }
eq_11 = name_6 == code_block_41
filterByBoolMask_19 = List.FilterByBoolMask(list=all_elements_of_category_5, mask=eq_11)

# group: Get the light sourse
categories_8 = Categories("OST_RvtLinks")
all_elements_of_category_6 = ElementsOfCategory(Category=categories_8)
categories_9 = Categories("OST_LightingFixtures")
ofCategory_3 = Revit.LinkElement.OfCategory(linkInstance=all_elements_of_category_6, category=categories_9)
flatten_16 = List.Flatten(list=ofCategory_3)
name_7 = Element.Name(element=flatten_16)
code_block_42 = CodeBlock { "D1 - Ceiling Recessed Downlight"; }
eq_12 = name_7 == code_block_42
code_block_43 = CodeBlock { "D2 - Ceiling Recessed Downlight"; }
eq_13 = name_7 == code_block_43
or_3 = eq_12 || eq_13
filterByBoolMask_20 = List.FilterByBoolMask(list=flatten_16, mask=or_3)
code_block_44 = CodeBlock { "SP-6"; }
eq_14 = name_7 == code_block_44
or_4 = Or(bool0=eq_12, bool1=eq_13, bool2=eq_14)

# group: Get Geometry
geometry_9 = Element.Geometry(element=filterByBoolMask_20.in)
byUnion = Solid.ByUnion(solids=geometry_9@L2)
list_clean_5 = Custom[List Clean](list=byUnion)
byGeometry_7 = BoundingBox.ByGeometry(geom=list_clean_5)
toCuboid_6 = BoundingBox.ToCuboid(boundingBox=byGeometry_7)

# group: Get Geometry
geometry_10 = Element.Geometry(element=filterByBoolMask_19.in)
flatten_17 = List.Flatten(list=geometry_10)
doesIntersect_4 = Geometry.DoesIntersect(geometry=flatten_17@L1, other=toCuboid_6)
anyTrue_4 = List.AnyTrue(list=doesIntersect_4, lacing=Longest)
filterByBoolMask_21 = List.FilterByBoolMask(list=flatten_17, mask=anyTrue_4)
flatten_18 = List.Flatten(list=filterByBoolMask_21.in)

# group (continued): Get J5.1 Ceiling
filterByBoolMask_22 = List.FilterByBoolMask(list=filterByBoolMask_19.in, mask=anyTrue_4)

# group: Get Points
code_block_45 = CodeBlock { 1; }
chop_4 = List.Chop(list=filterByBoolMask_22.in, lengths=code_block_45)
intersectAll_3 = Geometry.IntersectAll(geometry=flatten_18@L1, others=toCuboid_6, lacing=CrossProduct)
flatten_19 = List.Flatten(list=intersectAll_3@L3)
centroid_3 = Solid.Centroid(solid=flatten_19)

# group: Family Creator
code_block_46 = CodeBlock { "Ar_GM_Void_Slab_Opening_Circular"; }
byName_3 = Family.ByName(name=code_block_46)
types_3 = Family.Types(family=byName_3)
ꟿ_familyinstance_byhostandpoint_3 = Custom[ꟿ FamilyInstance.ByHostAndPoint](host=chop_4, type=types_3, point=centroid_3)
code_block_47 = CodeBlock { "Radius"; }
code_block_48 = CodeBlock { 38.2; }
ʳʰʸᵗʰᵐ_elements_19 = Rhythm.Revit.Elements.Elements.SetParameterByNameTypeOrInstance(element=ꟿ_familyinstance_byhostandpoint_3, parameterName=code_block_47, value=code_block_48, lacing=Longest)

point = Hood.Create_Point.Point()
