# Dynamo graph Ceiling Opening V 1.0.dyn (Dynamo 2.12.1.8246)
# packages: Universo_BIM 17.3.21, Genius Loci 2023.1.23

select_model_element = DSModelElementSelection()  # 1 picked in the model

# group: Familt Data
parameters = Element.Parameters(element=select_model_element)
watch = Watch(parameters)
type = Elements.Element.Type(element=select_model_element)
parameters_2 = Element.Parameters(element=type)
watch_2 = Watch(parameters_2)

categories = Categories("OST_LightingFixtures")
all_elements_of_category = ElementsOfCategory(Category=categories)
byCorners = BoundingBox.ByCorners()
byGeometry = BoundingBox.ByGeometry()  # unwired: geom
contains = BoundingBox.Contains()  # unwired: boundingBox, point
byGeometry_2 = BoundingBox.ByGeometry()  # unwired: geom
geometry = Element.Geometry(element=select_model_element)
byUnion = Solid.ByUnion(solids=geometry)
list_clean = Custom[List Clean](list=byUnion)  # package Genius Loci; Removes all Null, Empty and Blank from a list or nested list of lists.
byGeometry_3 = BoundingBox.ByGeometry(geom=list_clean)
toCuboid = BoundingBox.ToCuboid(boundingBox=byGeometry_3)
centroid = Solid.Centroid(solid=toCuboid)
element_host = Custom[Element Host](element=select_model_element)  # package Genius Loci; Gets the host of the element. Unlike the OOTB node FamilyInstance.GetHost, it also works for elements hosted by a linked document, wall sweeps, foundations, railings and builing pads. Based on a Clockwork's node
code_block = CodeBlock {  }
vertices = Topology.Vertices(topology=toCuboid)
adjacentEdges = Vertex.AdjacentEdges(vertex=vertices)
startVertex = Edge.StartVertex(edge=adjacentEdges)
startVertex_2 = Edge.StartVertex(edge=adjacentEdges)
pointGeometry = Vertex.PointGeometry(vertex=vertices)
edges = Topology.Edges(topology=toCuboid)
curveGeometry = Edge.CurveGeometry(edge=edges)
endPoint = Curve.EndPoint(curve=curveGeometry)
startPoint = Curve.StartPoint(curve=curveGeometry)
X = Point.X(point=startPoint)
firstItem = List.FirstItem(list=startPoint)
X_2 = Point.X(point=firstItem)
eq = X == X_2
firstItem_2 = List.FirstItem(list=startPoint)
Z = Point.Z(point=firstItem_2)
Z_2 = Point.Z(point=startPoint)
eq_2 = Z == Z_2
and_ = eq && eq_2
filterByBoolMask = List.FilterByBoolMask(list=startPoint, mask=and_)
flatten = List.Flatten(list=filterByBoolMask.in)
faces = Topology.Faces(topology=toCuboid)
surfaceGeometry = Face.SurfaceGeometry(face=faces)
area = Surface.Area(surface=surfaceGeometry)
maximumItem = List.MaximumItem(list=area)
eq_3 = area == maximumItem
filterByBoolMask_2 = List.FilterByBoolMask(list=surfaceGeometry, mask=eq_3)
firstItem_3 = List.FirstItem(list=filterByBoolMask_2.in)
width = Cuboid.Width(cuboid=toCuboid)
