# Dynamo graph Ceiling Opening V 1.1.dyn (Dynamo 2.12.1.8246)
# packages: Genius Loci 2023.1.23, bimorphNodes 4.2.4, Universo_BIM 17.3.21, spring nodes 210.1.1

categories = Categories("OST_RvtLinks")
all_elements_of_category = ElementsOfCategory(Category=categories)
categories_2 = Categories("OST_LightingFixtures")
ofCategory = Revit.LinkElement.OfCategory(linkInstance=all_elements_of_category, category=categories_2)
flatten = List.Flatten(list=ofCategory)
name = Element.Name(element=flatten)
code_block = CodeBlock { "D1 - Ceiling Recessed Downlight"; }
eq = name == code_block
filterByBoolMask = List.FilterByBoolMask(list=flatten, mask=eq)
geometry = Element.Geometry(element=filterByBoolMask.in)
byUnion = Solid.ByUnion(solids=geometry@L2)
list_clean = Custom[List Clean](list=byUnion)  # package Genius Loci; Removes all Null, Empty and Blank from a list or nested list of lists.
byGeometry = BoundingBox.ByGeometry(geom=list_clean)
toCuboid = BoundingBox.ToCuboid(boundingBox=byGeometry)
width = Cuboid.Width(cuboid=toCuboid)
height = Cuboid.Height(cuboid=toCuboid)
length = Cuboid.Length(cuboid=toCuboid)
element_host = Custom[Element Host](element=filterByBoolMask.in)  # package Genius Loci; Gets the host of the element. Unlike the OOTB node FamilyInstance.GetHost, it also works for elements hosted by a linked document, wall sweeps, foundations, railings and builing pads. Based on a Clockwork's node
element_host_2 = Custom[Element Host]()  # unwired: element

# group: Familt Data
type = Elements.Element.Type(element=filterByBoolMask.in)
parameters = Element.Parameters(element=type)
watch = Watch(parameters)
parameters_2 = Element.Parameters(element=filterByBoolMask.in)
watch_2 = Watch(parameters_2)

categories_3 = Categories("OST_Ceilings")
all_elements_of_category_2 = ElementsOfCategory(Category=categories_3)
name_2 = Element.Name(element=all_elements_of_category_2)
code_block_2 = CodeBlock { "J5.1"; }
eq_2 = name_2 == code_block_2
filterByBoolMask_2 = List.FilterByBoolMask(list=all_elements_of_category_2, mask=eq_2)
watch_3 = Watch(filterByBoolMask_2.in)
geometry_2 = Element.Geometry(element=filterByBoolMask_2.in)
flatten_2 = List.Flatten(list=geometry_2)
intersectAll = Geometry.IntersectAll(geometry=flatten_2@L1, others=toCuboid, lacing=CrossProduct)
flatten_3 = List.Flatten(list=intersectAll@L3)
centroid = Solid.Centroid(solid=flatten_3)
watch_3d = Watch3D(centroid)
ꟿ_familyinstance_byhostandpoint = Custom[ꟿ FamilyInstance.ByHostAndPoint]()  # package spring nodes; Creates hosted family instances(doors/windows) at the specified points. You can feed either a single family type or a unique type for each instance.; unwired: host, type, point
code_block_3 = CodeBlock { "Ar_GM_Void_Slab_Opening_Circular"; }
byName = Family.ByName(name=code_block_3)
types = Family.Types(family=byName)
list_clean_2 = Custom[List Clean](list=centroid)
