# Dynamo graph Ceiling Opening V 1.2.dyn (Dynamo 2.12.1.8246)
# packages: Genius Loci 2023.1.23, bimorphNodes 4.2.4, Universo_BIM 17.3.21, spring nodes 210.1.1, Rhythm 2023.9.1

# group: Get the light sourse
categories = Categories("OST_RvtLinks")
all_elements_of_category = ElementsOfCategory(Category=categories)
categories_2 = Categories("OST_LightingFixtures")
ofCategory = Revit.LinkElement.OfCategory(linkInstance=all_elements_of_category, category=categories_2)
flatten = List.Flatten(list=ofCategory)
name = Element.Name(element=flatten)
code_block = CodeBlock { "D1 - Ceiling Recessed Downlight"; }
eq = name == code_block
code_block_2 = CodeBlock { "D2 - Ceiling Recessed Downlight"; }
eq_2 = name == code_block_2
or_ = eq || eq_2
filterByBoolMask = List.FilterByBoolMask(list=flatten, mask=or_)
code_block_3 = CodeBlock { "SP-6"; }

# group: Familt Data
type = Elements.Element.Type(element=filterByBoolMask.in)
parameters = Element.Parameters(element=type)
watch = Watch(parameters)
parameters_2 = Element.Parameters(element=filterByBoolMask.in)
watch_2 = Watch(parameters_2)

# group: Get J5.1 Ceiling
categories_3 = Categories("OST_Ceilings")
all_elements_of_category_2 = ElementsOfCategory(Category=categories_3)
name_2 = Element.Name(element=all_elements_of_category_2)
code_block_4 = CodeBlock { "J5.1"; }
eq_3 = name_2 == code_block_4
filterByBoolMask_2 = List.FilterByBoolMask(list=all_elements_of_category_2, mask=eq_3)

# group: Get Geometry
geometry = Element.Geometry(element=filterByBoolMask.in)
byUnion = Solid.ByUnion(solids=geometry@L2)
list_clean = Custom[List Clean](list=byUnion)  # package Genius Loci; Removes all Null, Empty and Blank from a list or nested list of lists.
byGeometry = BoundingBox.ByGeometry(geom=list_clean)
toCuboid = BoundingBox.ToCuboid(boundingBox=byGeometry)

# group: Get Geometry
geometry_2 = Element.Geometry(element=filterByBoolMask_2.in)
flatten_2 = List.Flatten(list=geometry_2)
doesIntersect = Geometry.DoesIntersect(geometry=flatten_2@L1, other=toCuboid)
anyTrue = List.AnyTrue(list=doesIntersect, lacing=Longest)
filterByBoolMask_3 = List.FilterByBoolMask(list=flatten_2, mask=anyTrue)
flatten_3 = List.Flatten(list=filterByBoolMask_3.in)

# group (continued): Get J5.1 Ceiling
filterByBoolMask_4 = List.FilterByBoolMask(list=filterByBoolMask_2.in, mask=anyTrue)

# group: Get Points
code_block_5 = CodeBlock { 1; }
chop = List.Chop(list=filterByBoolMask_4.in, lengths=code_block_5)
intersectAll = Geometry.IntersectAll(geometry=flatten_3@L1, others=toCuboid, lacing=CrossProduct)
flatten_4 = List.Flatten(list=intersectAll@L3)
centroid = Solid.Centroid(solid=flatten_4)

# group: Family Creator
code_block_6 = CodeBlock { "Ar_GM_Void_Slab_Opening_Circular"; }
byName = Family.ByName(name=code_block_6)
types = Family.Types(family=byName)
ꟿ_familyinstance_byhostandpoint = Custom[ꟿ FamilyInstance.ByHostAndPoint](host=chop, type=types, point=centroid)  # package spring nodes; Creates hosted family instances(doors/windows) at the specified points. You can feed either a single family type or a unique type for each instance.
code_block_7 = CodeBlock { "Radius"; }
code_block_8 = CodeBlock { 38.2; }
ʳʰʸᵗʰᵐ_elements = Rhythm.Revit.Elements.Elements.SetParameterByNameTypeOrInstance(element=ꟿ_familyinstance_byhostandpoint, parameterName=code_block_7, value=code_block_8, lacing=Longest)

eq_4 = name == code_block_3
or_2 = Or(bool0=eq, bool1=eq_2, bool2=eq_4)
