# Dynamo graph Ceiling Opening V 1.3.dyn (Dynamo 2.12.1.8246)
# packages: spring nodes 210.1.1, Rhythm 2023.9.1, Universo_BIM 17.3.21, bimorphNodes 4.2.4, Genius Loci 2023.1.23

# group: Get the light sourse
categories = Categories("OST_RvtLinks")
all_elements_of_category = ElementsOfCategory(Category=categories)
categories_2 = Categories("OST_Sprinklers")
ofCategory = Revit.LinkElement.OfCategory(linkInstance=all_elements_of_category, category=categories_2)
flatten = List.Flatten(list=ofCategory)
name = Element.Name(element=flatten)
code_block = CodeBlock { "SP-6"; }
eq = name == code_block
filterByBoolMask = List.FilterByBoolMask(list=flatten, mask=eq)

# group: Familt Data
type = Elements.Element.Type(element=filterByBoolMask.in)
parameters = Element.Parameters(element=type)
watch = Watch(parameters)
parameters_2 = Element.Parameters(element=filterByBoolMask.in)
watch_2 = Watch(parameters_2)

# group: Get J5.1 Ceiling
categories_3 = Categories("OST_Ceilings")
all_elements_of_category_2 = ElementsOfCategory(Category=categories_3)
name_2 = Element.Name(element=all_elements_of_category_2)
code_block_2 = CodeBlock { "J5.1"; }
eq_2 = name_2 == code_block_2
filterByBoolMask_2 = List.FilterByBoolMask(list=all_elements_of_category_2, mask=eq_2)

# group: Get Geometry
geometry = Element.Geometry(element=filterByBoolMask.in)
list_clean = Custom[List Clean](list=geometry)  # package Genius Loci; Removes all Null, Empty and Blank from a list or nested list of lists.
byGeometry = BoundingBox.ByGeometry(geom=list_clean)
toCuboid = BoundingBox.ToCuboid(boundingBox=byGeometry)

# group: Get Geometry
geometry_2 = Element.Geometry(element=filterByBoolMask_2.in)
flatten_2 = List.Flatten(list=geometry_2)
doesIntersect = Geometry.DoesIntersect(geometry=flatten_2@L1, other=toCuboid)
anyTrue = List.AnyTrue(list=doesIntersect, lacing=Longest)
filterByBoolMask_3 = List.FilterByBoolMask(list=flatten_2, mask=anyTrue)
flatten_3 = List.Flatten(list=filterByBoolMask_3.in)

# group (continued): Get J5.1 Ceiling
filterByBoolMask_4 = List.FilterByBoolMask(list=filterByBoolMask_2.in, mask=anyTrue)

# group: Get Points
code_block_3 = CodeBlock { 1; }
chop = List.Chop(list=filterByBoolMask_4.in, lengths=code_block_3)
intersectAll = Geometry.IntersectAll(geometry=flatten_3@L1, others=toCuboid, lacing=CrossProduct)
flatten_4 = List.Flatten(list=intersectAll@L3)
list_clean_2 = Custom[List Clean](list=flatten_4)
centroid = Solid.Centroid(solid=list_clean_2)

# group: Family Creator
code_block_4 = CodeBlock { "Ar_GM_Void_Slab_Opening_Circular"; }
byName = Family.ByName(name=code_block_4)
types = Family.Types(family=byName)
ꟿ_familyinstance_byhostandpoint = Custom[ꟿ FamilyInstance.ByHostAndPoint](host=chop, type=types, point=centroid)  # package spring nodes; Creates hosted family instances(doors/windows) at the specified points. You can feed either a single family type or a unique type for each instance.
code_block_5 = CodeBlock { "Radius"; }
code_block_6 = CodeBlock { 27.4; }
ʳʰʸᵗʰᵐ_elements = Rhythm.Revit.Elements.Elements.SetParameterByNameTypeOrInstance(element=ꟿ_familyinstance_byhostandpoint, parameterName=code_block_5, value=code_block_6, lacing=Longest)

# group: Get J5.1 Ceiling
categories_4 = Categories("OST_Ceilings")
all_elements_of_category_3 = ElementsOfCategory(Category=categories_4)
name_3 = Element.Name(element=all_elements_of_category_3)
code_block_7 = CodeBlock { "J5.1"; }
eq_3 = name_3 == code_block_7
filterByBoolMask_5 = List.FilterByBoolMask(list=all_elements_of_category_3, mask=eq_3)

# group: Get the light sourse
categories_5 = Categories("OST_RvtLinks")
all_elements_of_category_4 = ElementsOfCategory(Category=categories_5)
categories_6 = Categories("OST_LightingFixtures")
ofCategory_2 = Revit.LinkElement.OfCategory(linkInstance=all_elements_of_category_4, category=categories_6)
flatten_5 = List.Flatten(list=ofCategory_2)
name_4 = Element.Name(element=flatten_5)
code_block_8 = CodeBlock { "D1 - Ceiling Recessed Downlight"; }
eq_4 = name_4 == code_block_8
code_block_9 = CodeBlock { "D2 - Ceiling Recessed Downlight"; }
eq_5 = name_4 == code_block_9
or_ = eq_4 || eq_5
filterByBoolMask_6 = List.FilterByBoolMask(list=flatten_5, mask=or_)
code_block_10 = CodeBlock { "SP-6"; }

# group: Get Geometry
geometry_3 = Element.Geometry(element=filterByBoolMask_6.in)
byUnion = Solid.ByUnion(solids=geometry_3@L2)
list_clean_3 = Custom[List Clean](list=byUnion)
byGeometry_2 = BoundingBox.ByGeometry(geom=list_clean_3)
toCuboid_2 = BoundingBox.ToCuboid(boundingBox=byGeometry_2)

# group: Get Geometry
geometry_4 = Element.Geometry(element=filterByBoolMask_5.in)
flatten_6 = List.Flatten(list=geometry_4)
doesIntersect_2 = Geometry.DoesIntersect(geometry=flatten_6@L1, other=toCuboid_2)
anyTrue_2 = List.AnyTrue(list=doesIntersect_2, lacing=Longest)
filterByBoolMask_7 = List.FilterByBoolMask(list=flatten_6, mask=anyTrue_2)
flatten_7 = List.Flatten(list=filterByBoolMask_7.in)

# group (continued): Get J5.1 Ceiling
filterByBoolMask_8 = List.FilterByBoolMask(list=filterByBoolMask_5.in, mask=anyTrue_2)

# group: Get Points
code_block_11 = CodeBlock { 1; }
chop_2 = List.Chop(list=filterByBoolMask_8.in, lengths=code_block_11)
intersectAll_2 = Geometry.IntersectAll(geometry=flatten_7@L1, others=toCuboid_2, lacing=CrossProduct)
flatten_8 = List.Flatten(list=intersectAll_2@L3)
centroid_2 = Solid.Centroid(solid=flatten_8)

# group: Family Creator
code_block_12 = CodeBlock { "Ar_GM_Void_Slab_Opening_Circular"; }
byName_2 = Family.ByName(name=code_block_12)
types_2 = Family.Types(family=byName_2)
ꟿ_familyinstance_byhostandpoint_2 = Custom[ꟿ FamilyInstance.ByHostAndPoint](host=chop_2, type=types_2, point=centroid_2)
code_block_13 = CodeBlock { "Radius"; }
code_block_14 = CodeBlock { 38.2; }
ʳʰʸᵗʰᵐ_elements_2 = Rhythm.Revit.Elements.Elements.SetParameterByNameTypeOrInstance(element=ꟿ_familyinstance_byhostandpoint_2, parameterName=code_block_13, value=code_block_14, lacing=Longest)

# group: Familt Data
type_2 = Elements.Element.Type(element=filterByBoolMask_6.in)
parameters_3 = Element.Parameters(element=type_2)
watch_3 = Watch(parameters_3)
parameters_4 = Element.Parameters(element=filterByBoolMask_6.in)
watch_4 = Watch(parameters_4)

eq_6 = name_4 == code_block_10
or_2 = Or(bool0=eq_4, bool1=eq_5, bool2=eq_6)
